# Grasshopper definition builder_test.gh (Grasshopper 1.0.8)
# plug-ins: ComputeBuilder, Compuceraptor

num_nu = GetNumber(Slider(13, range=0..20), AtLeast=1, AtMost=1, Maximum=100, Minimum=10, TreeAccess=False)
get_string = GetString("fgdffgdfg", AtLeast=1, AtMost=1, TreeAccess=False)
ui_builder = UIBuilder(
    Enable=Toggle(True),
    Refresh=Button(),
    OpenPreview=Button(),
    Schema="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",
    SessionId="55a02125",
    Values="{\"12e4b4b9-2767-426b-baa5-0a0e1bcd0a5b\":10.7,\"3a1707e3-f116-4442-8a8d-d66777808bd4\":\"fgdffgdfg\"}")  # -> SessionID, Info, Schema
panel = Panel(num_nu)
sphere = Sphere(Base=PlaneXY(0, 0, 0), Radius=num_nu)
panel_2 = Panel(get_string)
number = Number(num_nu)
addition = Addition(A=number, B=Slider(100, range=0..1000))
display = Display(Geo=sphere)
context_print = ContextPrint(Text=addition)
schema = ContextPrint(Schema=ui_builder.Schema)
context_bake = ContextBake(Content=display)
